# Grasshopper definition breaker.gh (Grasshopper 1.0.7)
# info@esoarch.org
# European School of Architecture

panel = Panel("C:\Users\paude\Documents\00. Backup 2023\EXTERIOR\MASTER\MA IAAC\03. Cursada\01. Modulo 02\S3. dtmngmnt\02 Vue\00_Final_assignment\bimsc24-final-project\src\submissions\pauladesimone\assets\dino.3dm")
encodedfile = GetString(AtLeast=1, AtMost=1, TreeAccess=False)
file_path = FilePath(panel)
ghpython_script = GhPythonScript(data=encodedfile, FP=file_path)  # -> out, geom, layerIndex, layers, instances, instLayInd
# ---------- ghpython_script: Python ----------
import System
import Rhino

try:
    b64 = System.Convert.FromBase64String(data)
    _dmfile = Rhino.FileIO.File3dm.FromByteArray(b64)
except:
    _dmfile = Rhino.FileIO.File3dm.Read(FP)
    print _dmfile

objtable = _dmfile.Objects

geom = []
geomLayerIndexList = []
for obj in objtable:
    
    if not isinstance(obj.Geometry,Rhino.Geometry.InstanceReferenceGeometry):

        geom.append(obj.Geometry)
        geomLayerIndexList.append(obj.Attributes.LayerIndex)
        

geom_= geom
layerIndex_ = geomLayerIndexList

layers = []
for l in _dmfile.Layers:
    layers.append(l)
    
    




layers_ = layers



instances = []
instancesLayerIndexes = []

# 
for obj in objtable:
    
    if isinstance(obj.Geometry,Rhino.Geometry.InstanceReferenceGeometry):
        geom = obj.Geometry
        parentId = geom.ParentIdefId
        instanceDef = _dmfile.InstanceDefinitions.FindId(parentId)
        instanceDefIds = instanceDef.GetObjectIds()
        
        xf =  geom.Xform
        instancesLayerIndexes.append(obj.Attributes.LayerIndex)
        
        for idefId in instanceDefIds:
            instanceObj= _dmfile.Objects.FindId(idefId)
            newObjGeom = instanceObj.Geometry.Duplicate()
            newObjGeom.Transform(xf)
            instances.append(newObjGeom)
            
            
instances_ = instances
instLayInd_ = instancesLayerIndexes
# ---------- end ghpython_script ----------
bbox = BoundingBox(Content=ghpython_script.geom, Plane=PlaneXY(0, 0, 0))  # -> Box, Box_2
debrep = DeconstructBrep(Brep=bbox.Box)  # -> Faces, Edges, Vertices
ydiv = GetNumber(Slider(0.4, range=0..1), AtLeast=1, AtMost=1, Maximum=1.797693135e+308, Minimum=-1.797693135e+308, TreeAccess=False)
xdiv = GetNumber(Slider(0.5, range=0..1), AtLeast=1, AtMost=1, Maximum=1.797693135e+308, Minimum=-1.797693135e+308, TreeAccess=False)
zdiv = GetNumber(Slider(0.7, range=0..1), AtLeast=1, AtMost=1, Maximum=1.797693135e+308, Minimum=-1.797693135e+308, TreeAccess=False)
thickness = GetNumber(
    Slider(0.01, range=0.01..0.05),
    AtLeast=1,
    AtMost=1,
    Maximum=1.797693135e+308,
    Minimum=-1.797693135e+308,
    TreeAccess=False)
edge = GetNumber(Slider(0.5, range=0.1..0.5), AtLeast=1, AtMost=1, Maximum=1.797693135e+308, Minimum=-1.797693135e+308, TreeAccess=False)
area = Area(Geometry=debrep.Faces)  # -> Area, Centroid
pdecon = Deconstruct(Point=area.Centroid)  # -> XComponent, YComponent, ZComponent
multiplication = Multiplication(A=zdiv, B="2")
multiplication_2 = Multiplication(A=xdiv, B="2")
multiplication_3 = Multiplication(A=ydiv, B="2")
sort = SortList(Keys=pdecon.ZComponent, ValuesA=area.Centroid)  # -> Keys, ValuesA
item = ListItem(List=sort.ValuesA, Index=0, Wrap=True)
orient = Orient(Geometry=ghpython_script.geom, Source=item, Target=PlaneXY(0, 0, 0))  # -> Geometry, Transform

color = GetInteger(Slider(5, range=0..5), AtLeast=1, AtMost=1, Maximum=2147483647, Minimum=-2147483648, TreeAccess=False)
stream_filter = StreamFilter(
    Gate=color,
    Stream0=ColourSwatch(SwatchColor=RGB(145, 189, 237)),
    Stream1=ColourSwatch(SwatchColor=RGB(242, 145, 233)),
    Stream2=ColourSwatch(SwatchColor=RGB(255, 255, 255)),
    Stream3=ColourSwatch(SwatchColor=RGB(74, 217, 145)),
    Stream4=ColourSwatch(SwatchColor=RGB(158, 158, 158)),
    Stream5=ColourSwatch(SwatchColor=RGB(222, 224, 79)))

X = UnitX(Factor=1)
Y = UnitY(Factor=1)
Z = UnitZ(Factor=1)
contour = Contour(Shape=orient.Geometry, Point=Point(0, 0, 0), Direction=Y, Distance=multiplication_3)
contour_2 = Contour(Shape=orient.Geometry, Point=Point(0, 0, 0), Direction=X, Distance=multiplication_2)
contour_3 = Contour(Shape=orient.Geometry, Point=Point(0, 0, 0), Direction=Z, Distance=multiplication)
fillet = Fillet(Curve=contour_3, Radius=edge)
fillet_2 = Fillet(Curve=contour_2, Radius=edge)
fillet_3 = Fillet(Curve=contour, Radius=edge)
join = JoinCurves(Curves=fillet_2, Preserve=False)
join_2 = JoinCurves(Curves=fillet, Preserve=False)
join_3 = JoinCurves(Curves=fillet_3, Preserve=False)
Z_2 = UnitZ(Factor=thickness)
X_2 = UnitX(Factor=thickness)
Y_2 = UnitY(Factor=thickness)
boundary = BoundarySurfaces(Edges=join)
boundary_2 = BoundarySurfaces(Edges=join_3)
boundary_3 = BoundarySurfaces(Edges=join_2)
extr = Extrude(Base=boundary_3, Direction=Z_2)
extr_2 = Extrude(Base=boundary, Direction=X_2)
extr_3 = Extrude(Base=boundary_2, Direction=Y_2)
mesh = Mesh(extr_3)
mesh_2 = Mesh(extr)
mesh_3 = Mesh(extr_2)
mesh_colours = MeshColours(Mesh=flatten(mesh_3), Colours=stream_filter)
mesh_colours_2 = MeshColours(Mesh=flatten(mesh), Colours=stream_filter)
mesh_colours_3 = MeshColours(Mesh=flatten(mesh_2), Colours=stream_filter)
merge = Merge(Data1=mesh_colours, Data2=mesh_colours_2, Data3=mesh_colours_3)
merge_2 = Merge(Data1=join, Data2=join_3, Data3=join_2)  # -> flatten(Result)
context_bake = ContextBake(Geometry=merge)

merge_3 = Merge(Data1=extr_2, Data2=extr_3, Data3=extr)  # -> flatten(Result)

area_2 = Area(Geometry=boundary_2)  # -> flatten(Area), Centroid
area_3 = Area(Geometry=boundary)  # -> flatten(Area), Centroid
area_4 = Area(Geometry=boundary_3)  # -> flatten(Area), Centroid
ma = MassAddition(Input=area_3.Area)  # -> flatten(Result), PartialResults
ma_2 = MassAddition(Input=area_2.Area)  # -> flatten(Result), PartialResults
ma_3 = MassAddition(Input=area_4.Area)  # -> flatten(Result), PartialResults
ma_4 = MassAddition(Input=[ma.Result, ma_2.Result, ma_3.Result])  # -> flatten(Result), PartialResults
round = Round(Number=ma_4.Result)  # -> Nearest, Floor, Ceiling
concat = Concatenate(FragmentB=round.Nearest, FragmentC="cm2")
panel_2 = Panel(concat)

debrep_2 = DeconstructBrep(Brep=merge_3)  # -> Faces, Edges, Vertices

len = Length(Curve=join)  # -> flatten(Length)
len_2 = Length(Curve=join_3)  # -> flatten(Length)
len_3 = Length(Curve=join_2)  # -> flatten(Length)
ma_5 = MassAddition(Input=[len, len_2, len_3])  # -> Result, PartialResults
division = Division(A=ma_5.Result, B=Slider(10, range=0..10))
number_slider = Slider(10, range=0..10)
multiplication_4 = Multiplication(A=round.Nearest, B="1.1")
multiplication_5 = Multiplication(A=division, B="1.1")
division_2 = Division(A=multiplication_4, B=number_slider)
division_3 = Division(A=multiplication_5, B=number_slider)
addition = Addition(A=division_2, B=division_3)
round_2 = Round(Number=addition)  # -> Nearest, Floor, Ceiling
concat_2 = Concatenate(FragmentB="$", FragmentC=round_2.Nearest)
panel_3 = Panel(concat_2)

mesh_4 = Mesh(merge)
msphere = MeshSphere(Base=PlaneXY(0, 0, 0), Radius=Slider(1, range=0..1), UCount=10, VCount=20)
mesh_5 = Mesh(ghpython_script.geom)
preview = CustomPreview(Geometry=mesh_4, Material="wood")

bbox_2 = BoundingBox(Content=orient.Geometry, Plane=PlaneXY(0, 0, 0))  # -> Box, Box_2
debrep_3 = DeconstructBrep(Brep=bbox_2.Box)  # -> Faces, Edges, Vertices
area_5 = Area(Geometry=debrep_3.Faces)  # -> Area, Centroid
pdecon_2 = Deconstruct(Point=area_5.Centroid)  # -> XComponent, YComponent, ZComponent
avr = Average(Input=pdecon_2.ZComponent)
smaller = SmallerThan(FirstNumber=pdecon_2.ZComponent, SecondNumber=avr)  # -> SmallerThan, OrEqualTo
equals = Equality(FirstNumber=pdecon_2.ZComponent, SecondNumber=avr)  # -> Equality, Inequality
cull = CullPattern(List=debrep_3.Faces, CullPattern=smaller.SmallerThan)
cull_2 = CullPattern(List=debrep_3.Faces, CullPattern=equals.Equality)
debrep_4 = DeconstructBrep(Brep=cull_2)  # -> Faces, Edges, Vertices
debrep_5 = DeconstructBrep(Brep=cull)  # -> Faces, Edges, Vertices
curvepoint = PointOnCurve(debrep_4.Edges, parameter=0.5)
item_2 = ListItem(List=debrep_5.Edges, Index=0, Wrap=True)  # -> Item, Item1
pdecon_3 = Deconstruct(Point=curvepoint)  # -> XComponent, YComponent, ZComponent
avr_2 = Average(Input=pdecon_3.ZComponent)
equals_2 = Equality(FirstNumber=pdecon_3.ZComponent, SecondNumber=avr_2)  # -> Equality, Inequality
cull_3 = CullPattern(List=curvepoint, CullPattern=equals_2.Inequality)
item_3 = ListItem(List=cull_3, Index=0, Wrap=True)  # -> Item, Item1
ln = Line(StartPoint=item_3.Item, EndPoint=item_3.Item1)
len_4 = Length(Curve=item_2.Item)
len_5 = Length(Curve=ln)
len_6 = Length(Curve=item_2.Item1)
multiplication_6 = Multiplication(A=len_4, B="10")
multiplication_7 = Multiplication(A=len_6, B="10")
multiplication_8 = Multiplication(A=len_5, B="10")
round_3 = Round(Number=multiplication_7)  # -> Nearest, Floor, Ceiling
round_4 = Round(Number=multiplication_6)  # -> Nearest, Floor, Ceiling
round_5 = Round(Number=multiplication_8)  # -> Nearest, Floor, Ceiling
concat_3 = Concatenate(
    FragmentA="b:",
    FragmentB=round_4.Nearest,
    FragmentC="x",
    FragmentD=round_3.Nearest,
    FragmentE="cm",
    FragmentF=" / ",
    FragmentG="h:",
    FragmentH=round_5.Nearest,
    FragmentI="cm")  # -> flatten(Result)
panel_4 = Panel(concat_3)

context_print = ContextPrint(Dimensions=panel_4)
material = ContextPrint(Material=panel_2)
context_print_2 = ContextPrint(Price=panel_3)
crv = Curve(flatten(debrep_2.Edges))
# curves need a property
panel_5 = Panel("color")

# ---- group: must be a string
uservalue = Text(ColourSwatch(SwatchColor=RGB(255, 0, 0)))
userkey = Text(panel_5)

# ----
# add color
c_script = CSharpScript(geometry=crv, userKey=userkey, userValue=uservalue)  # -> out, geoWithUserString; inputs geometry: GeometryBase, userKey: String, userValue: String
# ---------- c_script: C# ----------
    geometry.SetUserString(userKey, userValue);
   geoWithUserString = geometry;
# ---------- end c_script ----------
curve = Curve(flatten(c_script.geoWithUserString))
context_bake_2 = ContextBake(Geometry=curve)
