# Grasshopper definition maceteros_3js_script.gh (Grasshopper 1.0.7)
# plug-ins: Bifocals, ShapeDiverForGrasshopper

sddp = ShapeDiverDocumentPayload({AbsoluteTolerance=0, AngleTolerance=0, DistanceDisplayPrecision=0, GltfVersion="Gltf2", GrasshopperVersion="1.0.0007", InputGroups="{}", OutputGroups="{}", RelativeTolerance=0, RhinoVersion="7.35.23346.11001", UnitSystem=0, VersionCreated="1.14.0.0", VersionSaved="1.14.0.0"})

# ---- group: CONTOUR
contours = Slider(2, range=0..20)

# ---- group: WIDTH
width = Slider(10, range=0..100)

# ---- group: HEIGHT
height = Slider(15, range=0..100)

# ----
height_2 = GetInteger(height, AtLeast=1, AtMost=1, Maximum=2147483647, Minimum=-2147483648, TreeAccess=False)
width_2 = GetInteger(width, AtLeast=1, AtMost=1, Maximum=2147483647, Minimum=-2147483648, TreeAccess=False)
contours_2 = GetInteger(contours, AtLeast=1, AtMost=1, Maximum=2147483647, Minimum=-2147483648, Prompt="contours", TreeAccess=False)

pt = Point()  # disabled
pt_2 = Point()  # disabled

pt_3 = Point()  # disabled
pt_4 = Point()  # disabled

# ----
# INITIAL PARAMS
# SURFACE CREATION
xy = XYPlane(Origin=Point(0, 0, 0))

range = Range(Domain=Domain(0, 1), Steps=contours_2)
range_2 = Range(Domain=height_2, Steps=contours_2)

# ---- group: OVERALL SHAPE
graph = GraphMapper(
    range,
    x0=0,
    x1=1,
    y0=0,
    y1=1,
    container_name="Bezier",
    cpx=[0, 0.2228797376, 0.4168141186, 1],
    cpy=[0.6007709503, 0, 0, 0.8130962253])

# ----
multiplication = Multiplication(A=width_2, B=graph)

# ----
# CIRCLE BASE
cir = Circle(Plane=xy, Radius=multiplication)
Z = UnitZ(Factor=range_2)
move = Move(Geometry=cir, Motion=Z)  # -> Geometry, Transform

geo = Geometry(move.Geometry)
loft = Loft(Curves=geo, Options={Adjust=False, Closed=False, LoftEnds=0, LoftSimp=0, LoftType=0, Rebuild=10, Refit=0.01})
context_bake = ContextBake(Geometry=loft)
